# Grasshopper definition 160908_Tutorial02_SolarTool.gh (Grasshopper 0.9.76)
# plug-ins: goat, GrasshopperEnergyTools

# ---- group: Number of Divisions
number_slider = Slider(13, range=0..100)

# ---- group: Reference Curve from Rhino
# F.1.4
# The Grasshopper Definition
crv = Curve(reparameterize(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))

# ---- group: Analysis Building
# 1. Input Geometry
srf = Surface([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])

# ---- group: urban context mesh
mesh = Mesh(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)

# ----
divide = DivideCurve(Curve=crv, Count=number_slider, Kinks=False)  # -> Points, Tangents, Parameters
number_slider_2 = Slider(29, range=10..100)
number_slider_3 = Slider(0.3, range=0.1..0.5)
# Adjust the grips (white
# circles) of the graph
# mapper to change the
# profile of the surface
graph = GraphMapper(
    divide.Parameters,
    x0=0,
    x1=1,
    y0=0,
    y1=1,
    container_name="Sine Summation",
    Equation0_px=[0.3530805707, 0.1602914333],
    Equation0_py=[0.07637232542, 0.4391407967],
    Equation1_px=[0.9786729813, 0.8287795782],
    Equation1_py=[0.2505966425, 0.2505966425])
multiplication = Multiplication(A=graph, B=number_slider_2)
expression = Expression(x=divide.Parameters, y=number_slider_3, z=number_slider_2, Expression="Sin(x/y)*z")
# Draw a circle at each
# division point along the
# curve, normal to the
# tangent vector at each
# point.
circle = CircleCNR(Center=divide.Points, Normal=divide.Tangents, Radius=expression)
# Loft a surface between
# the circles
loft = Loft(Curves=circle, Options={Adjust=True, Closed=False, LoftEnds=0, LoftSimp=0, LoftType=2, Rebuild=10, Refit=0.01})
flip = Flip(Surface=loft)  # -> Surface, Result
mesh_uv = MeshSurface(Surface=flip.Surface, UCount=Slider(25, range=0..100), VCount=Slider(10, range=0..100), Overhang=True, Equalize=False)
demesh = DeconstructMesh(Mesh=mesh_uv)  # -> Vertices, Faces, Colours, Normals
deface = DeconstructFace(Face=demesh.Faces)  # -> CornerA, CornerB, CornerC, CornerD
item = ListItem(List=demesh.Vertices, Index=deface.CornerA, Wrap=True)
item_2 = ListItem(List=demesh.Vertices, Index=deface.CornerB, Wrap=True)
item_3 = ListItem(List=demesh.Vertices, Index=deface.CornerC, Wrap=True)
item_4 = ListItem(List=demesh.Vertices, Index=deface.CornerD, Wrap=True)
srf4pt = _4PointSurface(CornerA=item, CornerB=item_2, CornerC=item_3, CornerD=item_4)

# ---- group: Select Analysis Surface
# 2. Analysis Surface
number_slider_4 = Slider(5, range=1..5)

# ---- group: Analysis Mesh Resolution
panel = Panel("10")

# ----
flip_2 = Flip(Surface=srf4pt)  # -> Surface, Result
srf_2 = Surface(srf)
mesh_uv_2 = MeshSurface(Surface=flip_2.Surface, UCount="2", VCount="2", Overhang=True, Equalize=False)
debrep = DeconstructBrep(Brep=srf_2)  # -> Faces, Edges, Vertices
boundary = BoundarySurfaces(Edges=debrep.Edges)
mesh_uv_3 = MeshSurface(Surface=boundary, UCount=panel, VCount=panel, Overhang=True, Equalize=False)
item_5 = ListItem(List=flatten(mesh_uv_3), Index=number_slider_4, Wrap=True)
mesh_2 = Mesh(<mesh referenced from the Rhino model>)

# ---- group: Longitude
# 3. Location
panel_2 = Panel("8.5500025")

# ---- group: Latitude
panel_3 = Panel("47.367347")

# ----
area = Area(Geometry=mesh_uv_2)  # -> Area, Centroid

# ---- group: optimize
goat = Goat(fitness=ma_2, gene=number_slider_3)

# ----
panel_4 = Panel("""0
1
2
3
4
5
6
7
8
9
10
11
12
13
14
15
16
17
18
19
20
21
22
23""")
toggle = BooleanToggle(False)
mesh_3 = Mesh([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])
# 4. Three days obstruction calculation:
# summer, winter, equinox
number_slider_5 = Slider(2015, range=1999..2020)
sunvector = SunVector(
    Year=Slider(2015, range=1999..2020),
    Month=Slider(12, range=1..12),
    Day=Slider(22, range=1..31),
    Hour=panel_4,
    Longitude=panel_2,
    Latitude=panel_3,
    WholeYear=toggle)  # -> Vec, Azimuth, Altitude, DayOrNight
sunvector_2 = SunVector(
    Year=number_slider_5,
    Month=Slider(6, range=1..12),
    Day=Slider(21, range=1..31),
    Hour=panel_4,
    Longitude=panel_2,
    Latitude=panel_3,
    WholeYear=toggle)  # -> Vec, Azimuth, Altitude, DayOrNight
sunvector_3 = SunVector(
    Year=Slider(2015, range=1999..2020),
    Month=Slider(3, range=1..12),
    Day=Slider(20, range=1..31),
    Hour=panel_4,
    Longitude=panel_2,
    Latitude=panel_3,
    WholeYear=toggle)  # -> Vec, Azimuth, Altitude, DayOrNight

# ---- group: Visualize equinox day
radiation = Radiation(
    MshSimulateList=flatten(mesh_2),
    MshObstaclesList=flatten([mesh_3, mesh_2]),
    Sunvecs=sunvector_3.Vec,
    Dayornight=sunvector_3.DayOrNight)  # -> MshColouredList, DblShadowsList

# ---- group: Visualize summer day
radiation_2 = Radiation(
    MshSimulateList=flatten(mesh_2),
    MshObstaclesList=flatten([mesh_3, mesh_2]),
    Sunvecs=sunvector_2.Vec,
    Dayornight=sunvector_2.DayOrNight)  # -> MshColouredList, DblShadowsList

# ---- group: Visualize winter day
radiation_3 = Radiation(
    MshSimulateList=flatten(mesh_2),
    MshObstaclesList=flatten([mesh_3, mesh_2]),
    Sunvecs=sunvector.Vec,
    Dayornight=sunvector.DayOrNight)  # -> MshColouredList, DblShadowsList

# ---- group: Settings for Shading Mask
# 5. Diffuse Radiation
# Shading Mask
number_slider_6 = Slider(3, range=1..5)
toggle_2 = BooleanToggle(False)

# ----
shading_mask = ShadingMask(
    MshSimulateList=mesh_2,
    MshObstaclesList=mesh_3,
    ResolutionOfSkyDome=number_slider_6,
    SimplifiedCalculationOfShadingMask=toggle_2)  # -> ShadingMaskFactor, Dome
# 6. Weather Data.
# Obtained from .epw
panel_5 = Panel("""0
1
2
3
4
5
6""")
panel_6 = Panel("""0
1
2
3
4
5
6""")

# ---- group: DNI Direct Normal Radiation
data = Data(["key:location/dataType/units/frequency/startsAt/endsAt", "Zuerich-Kloten", "Direct Normal Radiation", "Wh/m2", "Hourly", "(1, 1, 1)"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])

# ---- group: DHI Diffuse Horizontal Radiation
data_2 = Data(["key:location/dataType/units/frequency/startsAt/endsAt", "Zuerich-Kloten", "Diffuse Horizontal Radiation", "Wh/m2", "Hourly", "(1, 1, 1)"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])

# ----
cull_i = CullIndex(List=data, Indices=panel_5, Wrap=True)
cull_i_2 = CullIndex(List=data_2, Indices=panel_6, Wrap=True)
# 7. Annual hourly solar profile
panel_7 = Panel("""1
2
3
4
5
6
7
8
9
10
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""")
panel_8 = Panel("""0
1
2
3
4
5
6
7
8
9
10
11
12
13
14
15
16
17
18
19
20
21
22
23""")
pvmodule = PVmodule(
    DNI=cull_i,
    DHI=cull_i_2,
    Φ=panel_3,
    Alldays=panel_7,
    Hours=panel_8,
    DTgmt="1",
    ShadowObjsSummer=radiation_2.DblShadowsList,
    ShadowObjsWinter=radiation_3.DblShadowsList,
    ShadowObjsEquinox=radiation.DblShadowsList,
    ShadingMask=shading_mask.ShadingMaskFactor)
ma = MassAddition(Input=pvmodule)  # -> Result, PartialResults
division = Division(A=ma.Result, B="1000")

# ---- group: kWh/m2a per panel
panel_9 = Panel(division)

# ----
multiplication_2 = Multiplication(A=flatten(panel_9), B=area.Area)

# ---- group: kWh/a per panel
panel_10 = Panel(multiplication_2)

# ----
ma_2 = MassAddition(Input=panel_10)  # -> Result, PartialResults

# ---- group: total kWh/a
panel_11 = Panel(ma_2.Result)

# ---- group: solar potentials (W/m2)
panel_12 = Panel(pvmodule)
