# Grasshopper definition 170324_solaroptimizationexample_04.gh (Grasshopper 0.9.76)
# plug-ins: GrasshopperEnergyTools

# ---- group: urban context mesh
# 1. Input Geometry
mesh = Mesh(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)

# ---- group: Surface to populate
srf = Surface(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)

# ----
# Optimization
galapagos = Galapagos(
    fitness=ma_2,
    gene=[number_slider_7, number_slider_8, number_slider_9, number_slider_4, number_slider_5, number_slider_6])

# ---- group: Longitude
# 3. Location
panel = Panel("8.5500025")

# ---- group: Latitude
panel_2 = Panel("47.367347")

# ----
panel_3 = Panel("""0
1
2
3
4
5
6
7
8
9
10
11
12
13
14
15
16
17
18
19
20
21
22
23""")
toggle = BooleanToggle(False)
mesh_2 = Mesh(mesh)
# 4. Three days obstruction calculation:
# summer, winter, equinox
number_slider = Slider(2015, range=1999..2020)
sunvector = SunVector(
    Year=Slider(2015, range=1999..2020),
    Month=Slider(12, range=1..12),
    Day=Slider(22, range=1..31),
    Hour=panel_3,
    Longitude=panel,
    Latitude=panel_2,
    WholeYear=toggle)  # -> Vec, Azimuth, Altitude, DayOrNight
sunvector_2 = SunVector(
    Year=number_slider,
    Month=Slider(6, range=1..12),
    Day=Slider(21, range=1..31),
    Hour=panel_3,
    Longitude=panel,
    Latitude=panel_2,
    WholeYear=toggle)  # -> Vec, Azimuth, Altitude, DayOrNight
sunvector_3 = SunVector(
    Year=Slider(2015, range=1999..2020),
    Month=Slider(3, range=1..12),
    Day=Slider(20, range=1..31),
    Hour=panel_3,
    Longitude=panel,
    Latitude=panel_2,
    WholeYear=toggle)  # -> Vec, Azimuth, Altitude, DayOrNight

# ---- group: Settings for Shading Mask
# 5. Diffuse Radiation
# Shading Mask
number_slider_2 = Slider(3, range=1..5)
toggle_2 = BooleanToggle(False)

# ----
# 6. Weather Data.
# Obtained from .epw
panel_4 = Panel("""0
1
2
3
4
5
6""")
panel_5 = Panel("""0
1
2
3
4
5
6""")

# ---- group: DNI Direct Normal Radiation
data = Data(["key:location/dataType/units/frequency/startsAt/endsAt", "Zuerich-Kloten", "Direct Normal Radiation", "Wh/m2", "Hourly", "(1, 1, 1)"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])

# ---- group: DHI Diffuse Horizontal Radiation
data_2 = Data(["key:location/dataType/units/frequency/startsAt/endsAt", "Zuerich-Kloten", "Diffuse Horizontal Radiation", "Wh/m2", "Hourly", "(1, 1, 1)"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])

# ----
cull_i = CullIndex(List=data, Indices=panel_4, Wrap=True)
cull_i_2 = CullIndex(List=data_2, Indices=panel_5, Wrap=True)
# 7. Annual hourly solar profile
panel_6 = Panel("""1
2
3
4
5
6
7
8
9
10
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""")
panel_7 = Panel("""0
1
2
3
4
5
6
7
8
9
10
11
12
13
14
15
16
17
18
19
20
21
22
23""")
number_slider_3 = Slider(5, range=1..5)

# ----
# Facade Shape
# Decision Variables
panel_8 = Panel("-0.01")
number_slider_4 = Slider(0.1, range=0.1..0.5)
number_slider_5 = Slider(-0.5, range=-0.5..-0.1)
number_slider_6 = Slider(0.699, range=0.05..0.7)
number_slider_7 = Slider(0.267, range=0.1..0.5)
number_slider_8 = Slider(-0.42, range=-0.5..-0.1)
number_slider_9 = Slider(0.801, range=0.8..1.45)
addition = Addition(A=number_slider_8, B=panel_8)
addition_2 = Addition(A=number_slider_5, B="-0.01")
pt = ConstructPoint(XCoordinate="0", YCoordinate="-2", ZCoordinate="0")
pt_2 = ConstructPoint(XCoordinate="0", YCoordinate="0", ZCoordinate="0")
pt_3 = ConstructPoint(XCoordinate="1.5", YCoordinate="-2", ZCoordinate="0")
pt_4 = ConstructPoint(XCoordinate="1.5", YCoordinate="0", ZCoordinate="0")
pt_5 = ConstructPoint(XCoordinate=number_slider_9, YCoordinate=addition, ZCoordinate=number_slider_7)
pt_6 = ConstructPoint(XCoordinate=number_slider_6, YCoordinate=number_slider_5, ZCoordinate=number_slider_4)
pt_7 = ConstructPoint(XCoordinate=number_slider_6, YCoordinate=addition_2, ZCoordinate=number_slider_4)
pt_8 = ConstructPoint(XCoordinate=number_slider_9, YCoordinate=number_slider_8, ZCoordinate=number_slider_7)
c_script = CSharpScript(p1=pt_2, p2=pt, p3=pt_3, p4=pt_4, p5=pt_6, p6=pt_7, p7=pt_5, p8=pt_8)  # -> out, A; inputs p1: Point3d, p2: Point3d, p3: Point3d, p4: Point3d, p5: Point3d, p6: Point3d, p7: Point3d, p8: Point3d
# ---------- c_script: C# ----------
    List<Point3d> pts = new List<Point3d>();
    pts.Add(p1);
    pts.Add(p2);
    pts.Add(p3);
    pts.Add(p4);

    pts.Add(p5);
    pts.Add(p6);
    pts.Add(p7);
    pts.Add(p8);

    Mesh msh = new Mesh();
    foreach(Point3d p in pts)
      msh.Vertices.Add(p);

    msh.Faces.AddFace(0, 1, 5, 4);
    msh.Faces.AddFace(2, 3, 7, 6);
    msh.Faces.AddFace(3, 0, 4, 7);

    A = msh;
    System.Threading.Thread.Sleep(500);
# ---------- end c_script ----------
c_script_2 = CSharpScript()  # -> out, p3d, str; inputs srf: Surface, msh: list of Mesh; disabled
# ---------- c_script_2: C# ----------
    //List<TextDot> d = new List<TextDot>();
    List<Point3d> ps = new List<Point3d>();
    List<string> s = new List<string>();
    foreach (Mesh m in msh)
    {
      int c = m.Vertices.Count;

      for(int i = 0; i < c; i++)
      {
        double x = m.Vertices[i].X;
        double y = m.Vertices[i].Y;
        double z = m.Vertices[i].Z;
        //TextDot dot = new TextDot(i.ToString(), new Point3d(x, y, z));
        //d.Add(dot);
        ps.Add(new Point3d(x, y, z));
        //        s.Add(i.ToString());
        s.Add(c.ToString());
      }
    }

    p3d = ps;
    str = s;
# ---------- end c_script_2 ----------
pt_9 = Point([pt_3, pt_4, pt_8, pt_5])
pt_10 = Point([pt_2, pt, pt_6, pt_7])
pt_11 = Point([pt_2, pt_4, pt_6, pt_5])
c_script_3 = CSharpScript(T=c_script_2.str, P=c_script_2.p3d)  # -> out, A; inputs T: String, P: Point3d; disabled
# ---------- c_script_3: C# ----------
    _text.Add(T);
    _points.Add(P);
# ---------- c_script_3: C# additional code ----------
  private readonly List<string> _text = new List<string>();
  private readonly List<Point3d> _points = new List<Point3d>();

  /// <summary>
  /// This method will be called once every solution, before any calls to RunScript.
  /// </summary>
  public override void BeforeRunScript()
  {
    _text.Clear();
    _points.Clear();
  }

  //Draw all meshes in this method.
  public override void DrawViewportMeshes(IGH_PreviewArgs args)
  {
    for (int i = 0; i < _text.Count; i++)
    {
      Plane plane ;
      args.Viewport.GetCameraFrame(out plane);
      plane.Origin = _points[i];

      args.Display.Draw3dText(_text[i], Color.Black, plane, 0.3, "Lucida Console");
    }
  }
# ---------- end c_script_3 ----------
del = DelaunayMesh(Points=pt_10, Plane=PlaneXY(0, 0, 0))
del_2 = DelaunayMesh(Points=pt_9, Plane=PlaneXY(0, 0, 0))
del_3 = DelaunayMesh(Points=pt_11, Plane=PlaneXY(0, 0, 0))
geo = Geometry(del_2)
geo_2 = Geometry(del_3)
number_slider_10 = Slider(111, range=1..300)
addition_3 = Addition(A=number_slider_10, B="300")
addition_4 = Addition(A=number_slider_10, B="600")

# ---- group: Geometry to array
geo_3 = Geometry(del)

# ----
# F.4.0.2
# Morphing Definition
number_slider_11 = Slider(50, range=0..50)
divide = DivideDomain²(Domain=srf, UCount=number_slider_11, VCount=Slider(6, range=0..10))
bbox = BoundingBox(Content=c_script.A, Plane=PlaneXY(0, 0, 0))  # -> Box, Box_2
sbox = SurfaceBox(Surface=srf, Domain=divide, Height=Slider(1.198, range=0..2))
morph = BoxMorph(Geometry=geo_3, Reference=bbox.Box, Target=sbox)

morph_2 = BoxMorph(Geometry=geo, Reference=bbox.Box, Target=sbox)
morph_3 = BoxMorph(Geometry=geo_2, Reference=bbox.Box, Target=sbox)
mesh_3 = Mesh([morph, morph_2, morph_3])
cull_i_3 = CullIndex(List=morph_3, Indices=number_slider_10, Wrap=True)
cull_i_4 = CullIndex(List=morph_2, Indices=addition_3, Wrap=True)
cull_i_5 = CullIndex(List=morph, Indices=addition_4, Wrap=True)
item = ListItem(List=flatten(mesh_3), Index=addition_4, Wrap=True)
item_2 = ListItem(List=flatten(mesh_3), Index=number_slider_10, Wrap=True)
item_3 = ListItem(List=flatten(mesh_3), Index=addition_3, Wrap=True)

# ----
# 2. Analysis Surface
mesh_4 = Mesh([item_2, item_3, item])

# ---- group: Visualize equinox day
radiation = Radiation(
    MshSimulateList=flatten(mesh_4),
    MshObstaclesList=flatten([mesh_2, mesh_4]),
    Sunvecs=sunvector_3.Vec,
    Dayornight=sunvector_3.DayOrNight)  # -> MshColouredList, DblShadowsList

# ---- group: Visualize summer day
radiation_2 = Radiation(
    MshSimulateList=flatten(mesh_4),
    MshObstaclesList=flatten([mesh_2, mesh_4]),
    Sunvecs=sunvector_2.Vec,
    Dayornight=sunvector_2.DayOrNight)  # -> MshColouredList, DblShadowsList

# ---- group: Visualize winter day
radiation_3 = Radiation(
    MshSimulateList=flatten(mesh_4),
    MshObstaclesList=flatten([mesh_2, mesh_4]),
    Sunvecs=sunvector.Vec,
    Dayornight=sunvector.DayOrNight)  # -> MshColouredList, DblShadowsList

# ----
shading_mask = ShadingMask(
    MshSimulateList=mesh_4,
    MshObstaclesList=mesh_2,
    ResolutionOfSkyDome=number_slider_2,
    SimplifiedCalculationOfShadingMask=toggle_2)  # -> ShadingMaskFactor, Dome
pvmodule = PVmodule(
    DNI=cull_i,
    DHI=cull_i_2,
    Φ=panel_2,
    Alldays=panel_6,
    Hours=panel_7,
    DTgmt="1",
    ShadowObjsSummer=radiation_2.DblShadowsList,
    ShadowObjsWinter=radiation_3.DblShadowsList,
    ShadowObjsEquinox=radiation.DblShadowsList,
    ShadingMask=shading_mask.ShadingMaskFactor)

# ---- group: solar potentials (W/m2)
panel_9 = Panel(pvmodule)

# ----
area = Area(Geometry=mesh_4)  # -> Area, Centroid
ma = MassAddition(Input=panel_9)  # -> Result, PartialResults
item_4 = ListItem(List=flatten(ma.Result), Index=number_slider_3, Wrap=True)
item_5 = ListItem(List=flatten(area.Area), Index=number_slider_3, Wrap=True)
panel_10 = Panel(item_4)
panel_11 = Panel(item_5)
panel_12 = Panel(ma.Result)
multiplication = Multiplication(A=panel_10, B=panel_11)
multiplication_2 = Multiplication(A=flatten(ma.Result), B=area.Area)
panel_13 = Panel(multiplication)

# ---- group: Total kWh/a on all facade elements
ma_2 = MassAddition(Input=multiplication_2)  # -> Result, PartialResults
panel_14 = Panel(ma_2.Result)

# ----
panel_15 = Panel(multiplication_2)
